# Grasshopper definition rd_mesh.gh (Grasshopper 1.0.7)
# plug-ins: HAL for Grasshopper, Kangaroo2 Components, PlanktonGh, Exoskeleton2, LunchBoxML

# ---- group: Cone 0
number_slider = Slider(20, range=0..100)  # disabled
brep = Brep([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])  # disabled
number_slider_2 = Slider(10, range=0..10)  # disabled
number_slider_3 = Slider(50, range=0..100)  # disabled
scale = Scale(Geometry=brep, Center=Point(0, 0, 0), Factor=number_slider)  # -> Geometry, Transform; disabled
number_slider_4 = Slider(1.3, range=0..10)  # disabled
join = BrepJoin(Breps=scale.Geometry)  # -> Breps, Closed; disabled
triremesh = TriRemesh(Geometry=join.Breps, Length=number_slider_4, Iterations=number_slider_3)  # -> Triangulation, Dual, Creases; disabled

# ---- group: Mesh ball Blank
number_slider_5 = Slider(63, range=0..100)  # disabled
number_slider_6 = Slider(50, range=0..100)  # disabled
msphere = MeshSphere(Base=PlaneXY(0, 0, 0), Radius=number_slider_5, UCount=number_slider_6, VCount=number_slider_6)  # disabled
number_slider_7 = Slider(2, range=0..10)  # disabled
number_slider_8 = Slider(50, range=0..100)  # disabled
triremesh_2 = TriRemesh(Geometry=msphere, Length=number_slider_7, Iterations=number_slider_8)  # -> Triangulation, Dual, Creases; disabled

# ---- group: TEST R TREEE
rtree_range = RTreePointsInRange()  # -> PointsWithinRange, IndicesWithinRange
rtree_cp = RTreeClosestPoint()  # -> ClosestPoint, ClosestIndex
rtree = CreateRTree()

# ---- group: Mesh Ball (6seed)
mesh = Mesh(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)  # disabled

# ---- group: remesh by color (K2)
mesh_2 = Mesh(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)  # disabled

# ---- group: Save pts to text file
python = GhPythonScript()  # -> out, a; disabled
# ---------- python: Python ----------
https:#//developer.rhino3d.com/guides/rhinopython/python-reading-writing/

import rhinoscriptsyntax as rs
 
#Get the points to export
objectIds = rs.GetObjects("Select Points",1+2, True, True)
if( objectIds==None ): return
 
#Get the filename to create
filter = "Text File (*.txt)|*.txt|All Files (*.*)|*.*||"
filename = rs.SaveFileName("Save point coordinates as", filter)
if( filename==None ): return
 
 
with open(filename, "w") as file:
     # treat the objects differently depending on whether they are points or point clouds
    for id in objectIds:
        #process point clouds
        if( rs.IsPointCloud(id) ):
        points = rs.PointCloudPoints(id)
        for pt in points:
            file.write(str(pt)+"\n")
        elif( rs.IsPoint(id) ):
        point = rs.PointCoordinates(id)
        file.write(str(point) + "\n")
# ---------- end python ----------

# ---- group: Read pts from text file
python_2 = GhPythonScript()  # -> out, a; disabled
# ---------- python_2: Python ----------
#https://developer.rhino3d.com/guides/rhinopython/python-reading-writing/

# Import points from a text file
import rhinoscriptsyntax as rs
 
def ImportPoints():
    #prompt the user for a file to import
    filter = "Text file (*.txt)|*.txt|All Files (*.*)|*.*||"
    filename = rs.OpenFileName("Open Point File", filter)
    if not filename: return
 
    #read each line from the file
    file = open(filename, "r")
    contents = file.readlines()
    file.close()
 
    # local helper function    
    def __point_from_string(text):
        items = text.strip("()\n").split(",")
        x = float(items[0])
        y = float(items[1])
        z = float(items[2])
        return x, y, z
 
    contents = [__point_from_string(line) for line in contents]
    rs.AddPoints(contents)
 
 
##########################################################################
# Check to see if this file is being executed as the "main" python
# script instead of being used as a module by some other python script
# This allows us to use the module which ever way we want.
if( __name__ == "__main__" ):
    ImportPoints()
# ---------- end python_2 ----------

# ----
sessionsettings = SessionSettings()

# ---- group: Current Dir
python_3 = GhPythonScript()  # -> out, a
# ---------- python_3: Python ----------
import rhinoscriptsyntax as rs

file_name = ghenv.Component.OnPingDocument().FilePath

print(file_name)
# ---------- end python_3 ----------
panel = Panel(python_3.out)

# ----
qrmesh = QuadRemesh(Mesh=triremesh.Triangulation, Settings={aqc=True, as=50, dhe=True, gci=0, null=False, pme=0, sa=0, tqc=2000})  # disabled

tc = TangentCircles(Mesh=mesh)  # -> Incircles, CirclePacking, Dual; disabled
circle = Circle(tc.Incircles)  # disabled
circle_2 = Circle(tc.CirclePacking)  # disabled
crv = Curve(tc.Dual)  # disabled

# ---- group: Plankton Mesh
number_slider_9 = Slider(5, range=0..10)  # disabled
triremesh_3 = TriRemesh(Geometry=mesh, Length=number_slider_9, Iterations=25)  # -> Triangulation, Dual, Creases; disabled
demesh = DeconstructMesh(Mesh=triremesh_3.Triangulation)  # -> Vertices, Faces, Colours, Normals; disabled
pmesh = PlanktonMesh(triremesh_3.Triangulation)  # disabled
number_slider_10 = Slider(0.84, range=0..1)  # disabled
planktonfrompoints = PlanktonFromPoints(PMesh=pmesh, Vertices=demesh.Vertices)  # disabled
toggle = BooleanToggle(True)  # disabled
deconstructplankton = DeconstructPlankton(PMesh=planktonfrompoints)  # -> Vertex_Points, Vertex_Outgoing_Halfedge, Halfedge_StartVertex, Halfedge_AdjacentFace, Halfedge_NextHalfedge, Halfedge_PrevHalfedge, Halfedge_Pair, Face_Halfedge; disabled
cyto = Cytoskeleton(PlanktonMesh=planktonfrompoints, Radius=number_slider_10, Dual=toggle)  # disabled

# ----
number_slider_11 = Slider(3, range=0..10)  # disabled
toggle_2 = BooleanToggle(False)  # disabled
number_slider_12 = Slider(2, range=0..10)  # disabled
number_slider_13 = Slider(5, range=0..10)  # disabled
dom = ConstructDomain(DomainStart=number_slider_12, DomainEnd=number_slider_13)  # disabled
remeshbycolour = RemeshByColour(Mesh=mesh, LengthInterval=dom, Flip=1, Iterations=number_slider_11, Reset=toggle_2)  # disabled
swatch = ColourSwatch(SwatchColor=RGB(168, 168, 168))  # disabled
mcol = MeshColours(Mesh=remeshbycolour, Colours=swatch)  # disabled

# ---- group: get mesh verticies neighbors / Mesh
dam = DataDam(DataA=triremesh_2.Triangulation, BufferDelay=10000000, BufferMode=0)  # disabled

# ---- group: Test Seed
path = FilePath("C:\Users\Prinz\Desktop\Projects\ISF\ReactionDiffusion\data\jsons\visualize.json")  # disabled

# ---- group: Test Seed / Open Json
python_4 = GhPythonScript(FilePath=path)  # -> out, r, b, a, initialA, initialB, s; disabled
# ---------- python_4: Python ----------
import rhinoscriptsyntax as rs
import json

# Opening JSON file
f = open(FilePath)
  
# returns JSON object as a dictionary
data = json.load(f)

r = data['results']
b = data['visB']
a = data['visA']
initialA = data['initialA']
initialB = data['initialB']

s = data['seed']
# ---------- end python_4 ----------

# ----
swatch_2 = ColourSwatch(SwatchColor=RGB(208, 255, 0))  # disabled
tangentincircles = TangentIncircles(Strength=1)
subtraction = Subtraction(A=python_4.b, B=python_4.a)  # disabled
rgb = ColourRGB(Alpha=255, Red=python_4.r, Green=python_4.r, Blue=python_4.r)  # disabled
abs = Absolute(Value=subtraction)  # disabled

# ---- group: Color Mesh
panel_2 = Panel("255")  # disabled
panel_3 = Panel("0")  # disabled
number_slider_14 = Slider(0, range=0..100)  # disabled
number_slider_15 = Slider(217, range=0..1000)  # disabled
dom_2 = ConstructDomain(DomainStart=panel_3, DomainEnd=panel_2)  # disabled
dom_3 = ConstructDomain(DomainStart=number_slider_14, DomainEnd=number_slider_15)  # disabled
remap = RemapNumbers(Value=python_4.r, Source=dom_2, Target=dom_3)  # -> Mapped, Clipped; disabled
int = Integer(remap.Mapped)  # disabled
rgb_2 = ColourRGB(Alpha=255, Red=int, Green=int, Blue=int)  # disabled

# ---- group: RD_mesh_ball
# OUTPUTS
mesh_3 = Mesh(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)

# ---- group: Offset Pts on Mesh
# Basic Concept
crv_2 = Curve(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)
boundary = BoundarySurfaces(Edges=crv_2)
smesh = SimpleMesh(Brep=boundary)
triremesh_4 = TriRemesh(Geometry=smesh, Length=Slider(2, range=0..10), Iterations=Slider(50, range=0..100))  # -> Triangulation, Dual, Creases
demesh_2 = DeconstructMesh(Mesh=triremesh_4.Triangulation)  # -> Vertices, Faces, Colours, Normals
item = ListItem(List=demesh_2.Vertices, Index=Slider(0, range=0..100), Wrap=True)
Z = UnitZ(Factor=Slider(5, range=0..10))

# ----
mindex = MemberIndex(Set=demesh_2.Vertices, Member=item)  # -> Index, Count

# ---- group: Offset Pts on Mesh (continued)
vn = VertexNeighbours(Mesh=triremesh_4.Triangulation, VertexNumber=mindex.Index)  # -> Vertex, Neighbours, Normal
merge = Merge(Data1=vn.Vertex, Data2=vn.Neighbours)  # -> flatten(Result)
mindex_2 = MemberIndex(Set=demesh_2.Vertices, Member=merge)  # -> Index, Count
move = Move(Geometry=merge, Motion=Z)  # -> Geometry, Transform
panel_4 = Panel(mindex_2.Index)
replace = ReplaceMembers(Set=demesh_2.Vertices, Find=merge, Replace=move.Geometry)
conmesh = ConstructMesh(Vertices=replace, Faces=demesh_2.Faces)

# ---- group: Plant Seed on 2d mesh
number_slider_16 = Slider(80, range=0..100)  # disabled
number_slider_17 = Slider(46, range=0..100)  # disabled
number_slider_18 = Slider(10, range=0..100)  # disabled

# ---- group: Plant seed on 3d mesh
number_slider_19 = Slider(7, range=0..10)  # disabled
number_slider_20 = Slider(50, range=0..100)  # disabled

# ---- group: get mesh verticies neighbors
demesh_3 = DeconstructMesh(Mesh=dam)  # -> Vertices, Faces, Colours, Normals; disabled

# ---- group: Plant Seed on 2d mesh (continued)
item_2 = ListItem(List=demesh_3.Vertices, Index=number_slider_16, Wrap=True)  # disabled
item_3 = ListItem(List=demesh_3.Vertices, Index=number_slider_17, Wrap=True)  # disabled
cir = Circle(Plane=[item_3, item_2], Radius=number_slider_18)  # -> graft(Circle); disabled
incurve = PointInCurve(Point=demesh_3.Vertices, Curve=cir)  # -> Relationship, Point; disabled
dispatch = Dispatch(List=demesh_3.Vertices, DispatchPattern=incurve.Relationship)  # -> ListA, ListB; disabled
pt = Point(flatten(dispatch.ListA))  # disabled
mindex_3 = MemberIndex(Set=demesh_3.Vertices, Member=pt)  # -> Index, Count; disabled

# ---- group: Plant seed on 3d mesh (continued)
lng = ListLength(List=demesh_3.Vertices)  # disabled
random = Random(Range=lng, Number=number_slider_19, Seed=Slider(38, range=0..100))  # disabled
int_2 = Integer(random)  # disabled
item_4 = ListItem(List=demesh_3.Vertices, Index=int_2, Wrap=True)  # disabled
sph = Sphere(Base=item_4, Radius=Slider(18, range=0..100))  # disabled
mindex_4 = MemberIndex(Set=demesh_3.Vertices, Member=item_4)  # -> simplify(Index), Count; disabled
item_5 = ListItem(List=demesh_3.Vertices, Index=mindex_4.Index, Wrap=True)  # disabled
cps = ClosestPoints(Point=item_5, Cloud=demesh_3.Vertices, Count=number_slider_20)  # -> ClosestPoint, flatten(CPIndex), Distance; disabled

# ----
lng_2 = ListLength(List=demesh_3.Vertices)  # disabled
series = Series(Start=0, Step=1, Count=lng_2)  # disabled

# ---- group: get mesh verticies neighbors (continued)
vn_2 = VertexNeighbours(Mesh=dam, VertexNumber=series)  # -> Vertex, Neighbours, Normal; disabled

# ----
mindex_5 = MemberIndex(Set=demesh_3.Vertices, Member=vn_2.Neighbours)  # -> Index, Count; disabled
mindex_6 = MemberIndex(Set=demesh_3.Vertices, Member=vn_2.Vertex)  # -> flatten(Index), Count; disabled
trim = TrimTree(Tree=mindex_5.Index, Depth=1)  # -> simplify(Tree); disabled

# ---- group: Test Nearest Neighbors
# Steps:
# 1. Setup Mesh
# 2. Define Seed
# 3. Export Json
# 4. Run script (samename.py in VS Code)
# 5. Import Json
number_slider_21 = Slider(100, range=0..100)  # disabled
number_slider_22 = Slider(471, range=0..1000)  # disabled
tstat = TreeStatistics(Tree=trim)  # -> Paths, Length, Count; disabled
item_6 = ListItem(List=tstat.Paths, Index=number_slider_22, Wrap=True)  # disabled
item_7 = ListItem(List=mindex_6.Index, Index=number_slider_22, Wrap=True)  # disabled
branch = TreeBranch(Tree=trim, Path=item_6, MaintainPaths=True)  # disabled
item_8 = ListItem(List=demesh_3.Vertices, Index=branch, Wrap=True)  # disabled

# ---- group: get mesh verticies neighbors / Mesh Convolution
# laplace_indices
# Neighbors
# Seed
int_3 = Integer(flatten(cps.CPIndex))  # disabled
int_4 = Integer(mindex_6.Index)  # disabled
int_5 = Integer(trim)  # disabled
pt_2 = Point(demesh_3.Vertices)  # disabled
# mesh
# verticies
mesh_4 = Mesh(dam)  # disabled

# ----
# faces
txt = Text(demesh_3.Faces)  # disabled
item_9 = ListItem(List=demesh_3.Vertices, Index=item_7, Wrap=True)  # disabled
item_10 = ListItem(List=demesh_3.Vertices, Index=cps.CPIndex, Wrap=True)  # disabled

# ---- group: Write Json
button = Button()  # disabled
python_5 = GhPythonScript(Dump=button, Pts=pt_2, Li=int_4, N=int_5, S=int_3)  # -> out; inputs Dump: Boolean, Pts: list of Point3d, Li: list of Int32, N: tree of Int32, S: list of Int32; disabled
# ---------- python_5: Python ----------
#https://stackoverflow.com/questions/25924244/creating-2d-dictionary-in-python

import rhinoscriptsyntax as rs
import json
import Grasshopper as gh
import ghpythonlib.treehelpers as th

##1D dict structure EXAMPLE
#sample_dict = {'pts':{}}
#sample_dict['pts']['pt'] = {'X': 1.5, 'Y': 2.5, 'Z': 3.5}
##print(sample_dict)
#
##2D dict structure EXAMPLE
#sample_2Ddict = {'pts':[]}
#sample_2Ddict['pts'].append({'pt': {'X': 1.5, 'Y': 2.5, 'Z': 3.5}})
##print(sample_2Ddict)

output = {}

#laplace order  
laplace = {'laplace_indices':[]}
for i in range(len(Li)):
    laplace['laplace_indices'].append(Li[i])
output.update(laplace)

#verticies
pts_dict = {'mesh_verticies':[]}
for i in range(len(Pts)):
    X = Pts[i].X
    Y = Pts[i].Y
    Z = Pts[i].Z
    pts_dict['mesh_verticies'].append({'pt': {'X': X, 'Y': Y, 'Z': Z}})
output.update(pts_dict)

#convert N to list of list
n_list = []
for i in range(N.BranchCount):
    branchList = N.Branch(i)
    branchPath = N.Path(i)
    n_list.append([])
    for j in range(branchList.Count):
        n_list[i].append(branchList[j])
        
n_dict = {'vertex_neighbors':[]}
for i in range(len(n_list)):
    n_dict['vertex_neighbors'].append([])
    for j in range(len(n_list[i])):
        n_dict['vertex_neighbors'][i].append(n_list[i][j])
output.update(n_dict)

seed_dict = {'seed_pts':[]}
for i in S:
    seed_dict['seed_pts'].append(i)
output.update(seed_dict)

if Dump:
    with open(r"C:\Users\Prinz\Desktop\Projects\ISF\ReactionDiffusion\data\jsons\mesh_attributes.json", 'w') as f:
        json.dump(output, f, indent=4)
        f.close()
        print("json updated")

print("see mesh_attribues.json")
# ---------- end python_5 ----------
panel_5 = Panel(python_5)  # disabled

# ---- group: vertex numbers
lng_3 = ListLength(List=pt_2)  # disabled
series_2 = Series(Start=0, Step=1, Count=lng_3)  # disabled
tag = TextTag(Location=pt_2, Text=series_2, Colour=swatch_2)  # disabled

# ---- group: Seed numbers
item_11 = ListItem(List=pt_2, Index=int_3, Wrap=True)  # disabled
item_12 = ListItem(List=series_2, Index=int_3, Wrap=True)  # disabled
tag_2 = TextTag(Location=item_11, Text=item_12, Colour=swatch_2)  # disabled

# ---- group: Colored Pts
number_slider_23 = Slider(2.3, range=0..10)  # disabled
cloud = CloudDisplay(Points=demesh_3.Vertices, Colours=rgb, Size=number_slider_23, SpriteType=0)  # disabled

# ---- group: b
tag_3 = TextTag(Location=pt_2, Text=python_4.b, Colour=swatch_2)  # disabled

# ---- group: a
tag_4 = TextTag(Location=pt_2, Text=python_4.a, Colour=swatch_2)  # disabled

# ---- group: b - a
tag_5 = TextTag(Location=pt_2, Text=abs, Colour=swatch_2)  # disabled

# ---- group: results
tag_6 = TextTag(Location=pt_2, Text=python_4.r, Colour=swatch_2)  # disabled

# ---- group: initialA
tag_7 = TextTag(Location=pt_2, Text=python_4.initialA, Colour=swatch_2)  # disabled

# ---- group: initialB
tag_8 = TextTag(Location=pt_2, Text=python_4.initialB, Colour=swatch_2)  # disabled

# ---- group: Colored Mesh
mcol_2 = MeshColours(Mesh=mesh_4, Colours=rgb)  # disabled

# ---- group: initial (b4 loop seed)
tag_9 = TextTag(Location=pt_2, Text=python_4.s, Colour=swatch_2)  # disabled

# ---- group: Offset Pts
number_slider_24 = Slider(2, range=0..10)  # disabled
panel_6 = Panel("255")  # disabled
panel_7 = Panel("0")  # disabled
dom_4 = ConstructDomain(DomainStart=panel_7, DomainEnd=panel_6)  # disabled
panel_8 = Panel("0")  # disabled
vec = VectorXYZ(XComponent=panel_8, YComponent=panel_8, ZComponent=python_4.r)  # -> Vector, Length; disabled

# ----
neg = Negative(Value=number_slider_24)  # disabled

# ---- group: Offset Pts (continued)
dom_5 = ConstructDomain(DomainStart=neg, DomainEnd=number_slider_24)  # disabled
remap_2 = RemapNumbers(Value=python_4.r, Source=dom_4, Target=dom_5)  # -> Mapped, Clipped; disabled
amp = Amplitude(Vector=demesh_3.Normals, Amplitude=remap_2.Mapped)  # disabled
move_2 = Move(Geometry=demesh_3.Vertices, Motion=amp)  # -> simplify(Geometry), Transform; disabled

# ---- group: Make Mesh
conmesh_2 = ConstructMesh(Vertices=flatten(move_2.Geometry), Faces=demesh_3.Faces)  # disabled
mcol_3 = MeshColours(Mesh=conmesh_2, Colours=rgb_2)  # disabled
